# Grasshopper definition FloorPlanGH.gh (Grasshopper 1.0.7)
# plug-ins: TT Toolbox

boolean_toggle = BooleanToggle(True)
read_excel_sheet = ReadExcelSheet(Run=boolean_toggle, Worksheet="1", Listen=boolean_toggle)  # -> UserMessages, Columns, Rows
partitiontreeatchar = CSharpScript(data=read_excel_sheet.Rows, erase="*")  # -> A; inputs data: tree of String, erase: String
# ---------- partitiontreeatchar: C# ----------
    var treeOut = new DataTree<string>();
    int path = 0;

    for( int i = 0; i < data.BranchCount; ++i )
      for( int j = 0; j < data.Branch(i).Count; ++j )
      {

        if( data.Branch(i)[j] != erase )
        {

          treeOut.Add(data.Branch(i)[j], new GH_Path(path));
          //path++;

        }
        
        else
        {
        
          path++;
        
        }

      }

    A = treeOut;
# ---------- end partitiontreeatchar ----------
partitiontreeatchar_2 = CSharpScript(data=partitiontreeatchar, erase="*")  # -> A; inputs data: tree of String, erase: String
# ---------- partitiontreeatchar_2: C# ----------
    var treeOut = new DataTree<string>();

    foreach( var path in data.Paths )
    {
    
      var branch = data.Branch(path);
      
      foreach( var item in branch )
      {
      
        if( !String.IsNullOrEmpty(item) )
        treeOut.Add( item, path );
      
      }
    
    }

    A = treeOut;
# ---------- end partitiontreeatchar_2 ----------
partition_list = PartitionList(List=partitiontreeatchar_2, Size=Slider(4, range=0..10))
text = Text(partition_list)
panel = Panel(text)
